# Dynamo graph DeleteAndPurgeTypeByName.dyn (Dynamo 3.6.0.9395)
# Deletes and purges specific element types by their string Name

string = StringInput("Ben")
python_script_delete_by_name = Python(IN[0]=string)  # CPython3
# ---------- python_script_delete_by_name.python (68 lines) ----------
import clr
clr.AddReference('RevitAPI')
from Autodesk.Revit.DB import *

clr.AddReference('RevitServices')
import RevitServices
from RevitServices.Persistence import DocumentManager
from RevitServices.Transactions import TransactionManager

doc = DocumentManager.Instance.CurrentDBDocument

input_names = UnwrapElement(IN[0])
if not isinstance(input_names, list):
    input_names = [input_names]
    
input_names = [str(n).strip().lower() for n in input_names if n]

deleted_elements_count = 0
errors = []
found_names = []

TransactionManager.Instance.EnsureInTransaction(doc)

types = FilteredElementCollector(doc).WhereElementIsElementType().ToElements()
instances = FilteredElementCollector(doc).WhereElementIsNotElementType().ToElements()
all_elems = list(types) + list(instances)

elements_to_delete = []
for e in all_elems:
    try:
        if not e.IsValidObject:
            continue
        if not hasattr(e, "Name") or not e.Name:
            continue
            
        e_name = e.Name.strip().lower()
        for search_name in input_names:
            if search_name == e_name:
                elements_to_delete.append(e)
                found_names.append(e.Name)
            elif search_name in e_name and len(search_name) > 2:
                hint = "Hint: Found '" + e.Name + "'"
                if hint not in errors:
                    errors.append(hint)
    except:
        pass

if not elements_to_delete:
    errors.append("ERROR: Could not find any exact match for your input.")

for elem in elements_to_delete:
    try:
        # Extremely safe verification to prevent InvalidObjectException
        if not elem.IsValidObject:
            continue
            
        doc.Delete(elem.Id)
        deleted_elements_count += 1
    except Exception as e:
        pass

TransactionManager.Instance.TransactionTaskDone()

OUT = [
    "SUCCESS! Items destroyed: " + str(deleted_elements_count),
    "Destroyed Names: " + str(found_names),
    "Hints log: " + str(errors)
]
# ----------------------------------------
